# Grasshopper definition cw_example_facade.gh (Grasshopper 1.0.7)
# plug-ins: CadworkGrasshopper, Bifocals

# ----
# supported by
# Ursula Frick
# Head of Advanced Geometry Group
# Blumer-Lehmann AG
image = ImageSampler(
    FilePath="C:\Users\admin\Downloads\cadwork-vector-logo.png",
    Filter="Colour",
    Interpolate=True,
    Umax=875,
    Umin=1,
    Vmax=196,
    Vmin=1,
    Wrap=1)

formdefiningguidecrvs = Curve(graft([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]))
number_of_elements = Slider(80, range=0..1000)
thickness = Slider(39, range=0..100)
logo_as_closedcrvs = Curve(flatten([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]))

# ---- group: Extract the 1st straight line
item = ListItem(List=flatten(formdefiningguidecrvs), Index=0, Wrap=True)

# ----
pframes = PerpFrames(Curve=item, Count=number_of_elements, Align=True)  # -> Frames, Parameters
X = UnitX(Factor=thickness)
boundary = BoundarySurfaces(Edges=logo_as_closedcrvs)
pcx = CurvePlane(Curve=formdefiningguidecrvs, Plane=pframes.Frames)  # -> simplify(Points), ParamsC, ParamsP
path_mapper = PathMapper(pcx.Points, source="{A;B}", target="{A}")
flip = FlipMatrix(Data=path_mapper)
pline = PolyLine(Vertices=flip, Closed=True)
boundary_2 = BoundarySurfaces(Edges=pline)
extr = Extrude(Base=boundary, Direction=X)
extr_2 = Extrude(Base=boundary_2, Direction=X)
sdiff = SolidDifference(BrepsA=extr_2, BrepsB=flatten(extr))

# ---- group: Set Parameters
panel = Panel("Fassadenbalken")
panel_2 = Panel("Fassade")
panel_3 = Panel("Fassade_Süd")
panel_4 = Panel("Eiche")
number_slider = Slider(42, range=0..42)
panel_5 = Panel("Grasshopper_Building")
panel_6 = Panel("Grasshopper_Storey")
panel_7 = Panel("IfcMember")

# ----
cw_std_attr = StdAttr(Material=panel_4, Color=number_slider, BIM_Building=panel_5, BIM_Storey=panel_6, Ifc_Element_Type=panel_7)
cw_attr = CwAttr(Name=panel, Group=panel_2, Subgroup=panel_3, User199Keys="cw_FireRating", User199Values="R30")

cw_panel = Panel(Geom=flatten(sdiff), CwAttr=cw_attr, StdAttr=cw_std_attr)
