# Grasshopper definition cw_sweep_beam.gh (Grasshopper 1.0.7)
# plug-ins: CadworkGrasshopper

image = ImageSampler(Filter="Colour", Interpolate=True, Umax=875, Umin=1, Vmax=196, Vmin=1, Wrap=1)

geo = Geometry([Point(-1934.755083, 818.3353098, 0), Point(421.990113, -2640.758445, -195.1792789), Point(4451.264157, -1170.960366, -356.0859939), Point(4425.922811, 1781.306465, 0), Point(1635.124457, 4368.79635, 547.4903925), Point(-411.9596108, 10052.17214, 1265.382933)])

intcrv_t = InterpolateT(Vertices=geo, TangentStart=Vector(0, 0, 0), TangentEnd=Vector(0, 0, 0), KnotStyle=1)  # -> Curve, Length, Domain
pframe = PerpFrame(Curve=reparameterize(intcrv_t.Curve), Parameter=Slider(0, range=0..1))
number_slider = Slider(120, range=0..1000)
number_slider_2 = Slider(240, range=0..1000)
reb = RebuildCurve(Curve=intcrv_t.Curve, Degree=Slider(3, range=0..10), Count=10, Tangents=False)

panel = Panel("""Cadwork Holz AG
True""")
panel_2 = Panel("""cw_Lieferant
cw_LoadBearing""")

dom = ConstructDomain(DomainStart=expr("x *0.5", number_slider), DomainEnd=expr("-x *0.5", number_slider))
dom_2 = ConstructDomain(DomainStart=expr("x *0.5", number_slider_2), DomainEnd=expr("-x *0.5", number_slider_2))
cw_attr = CwAttr(Name="Beam", User199Keys=panel_2, User199Values=panel)
rectangle = Rectangle(Plane=pframe, XSize=dom, YSize=dom_2, Radius=0)  # -> Rectangle, Length
swp1 = Sweep1(Rail=reb, Sections=rectangle.Rectangle, Miter=1)

int = Integer(5)

cap = CapHoles(Brep=swp1)
cw_std_attr = StdAttr(Material="GL 24h I", Color=int, BIM_Building="TestBuilding", BIM_Storey="TestStorey", Ifc_Element_Type="IfcMember")
cw_beam = Beam(Geom=flatten(cap), CwAttr=cw_attr, StdAttr=cw_std_attr, BakeCW=False)
